# Grasshopper definition 304_toolpath_generator.gh (Grasshopper 1.0.8)

sphere = Geometry(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)
tile_1 = Geometry(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)
tile_2 = Geometry(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)
tile_3 = Geometry(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)
toolpath_3 = Curve(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)
toolpath_1 = Curve(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)
toolpath_2 = Curve(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)

divide_curve = DivideCurve(Curve=toolpath_3, Count="20", Kinks=False)  # -> Points, Tangents, Parameters
python_3_script = Python3Script(points=divide_curve.Points)  # -> out, projected_curve, projected_points, frames, rhino_planes; inputs points: list of Point3d
# ---------- python_3_script: Python ----------
from compas.geometry import Point, Sphere, Polyline, Frame, Plane
from compas_rhino.conversions import point_to_compas, vector_to_rhino, frame_to_rhino

# sphere = Sphere(936.888)
sphere = Sphere(1400)

compas_points = []
for point in points:
    compas_points.append(point_to_compas(point))

projected_points = []
for point in compas_points:
    direction = point - Point(0, 0, 0)
    direction.unitize()
    projected_points.append(Point(0, 0, 0) + direction * sphere.radius)

projected_curve = Polyline(projected_points)

normal_vectors = []
for point in projected_points:
    normal = point - Point(0, 0, 0)
    normal.unitize()
    normal_vectors.append(normal)

frames = []
rhino_planes = []
for point, normal in zip(projected_points, normal_vectors):
    plane = Plane(point, normal)
    frame = Frame.from_plane(plane)

    frames.append(frame)
    rhino_planes.append(frame_to_rhino(frame))
# ---------- end python_3_script ----------
polyline = PolyLine(Vertices=divide_curve.Points, Closed=False)
# toolpath_3
point_list = PointList(Points=divide_curve.Points, Size="100")
compas_draw = COMPASDraw(cg=python_3_script.projected_curve)  # -> rg
#   port cg: The COMPAS geometry or datastructure to be drawn.
#   port rg: The Rhino geometry object.
# ---------- compas_draw: Python ----------
# r: compas>=2.14.1
"""
Draws COMPAS geometry in Grasshopper.
"""

from typing import Any

import Grasshopper

from compas.scene import SceneObject


class CompasToRhinoGeometry(Grasshopper.Kernel.GH_ScriptInstance):
    def RunScript(self, cg):
        if not cg:
            return None

        return SceneObject(item=cg).draw()
# ---------- end compas_draw ----------
compas_draw_2 = COMPASDraw(cg=python_3_script.projected_points)  # -> rg; same code as compas_draw
compas_draw_3 = COMPASDraw(cg=python_3_script.frames)  # -> rg; same code as compas_draw
point_list_2 = PointList(Points=compas_draw_2, Size="50")
save = Button()
python_3_script_2 = Python3Script(frames=python_3_script.frames, save=save)  # inputs frames: list
# ---------- python_3_script_2: Python ----------
from compas.data import json_dump
import os

numbered_frames = []
for index, frame in enumerate(frames, start=0):
    numbered_frames.append({"number": index, "frame": frame})

data = {}
data["name"] = "toolpath_3_v2"
data["coordinate_system"] = "wobj0"
data["units"] = "mm"
data["frames"] = numbered_frames

#get current file path
path = ghenv.Component.OnPingDocument().FilePath
#get parent directory of the parent directory
parentdir = os.path.dirname(path)
#get src folder which contains classes
dire = os.path.join(parentdir,'data')


filepath = os.path.join(dire, "toolpath_3_v2.json")

if save:
    json_dump(data, filepath)
# ---------- end python_3_script_2 ----------

divide_curve_2 = DivideCurve(Curve=toolpath_1, Count="20", Kinks=False)  # -> Points, Tangents, Parameters
python_3_script_3 = Python3Script(points=divide_curve_2.Points)  # -> out, projected_curve, projected_points, frames, rhino_planes; inputs points: list of Point3d
# ---------- python_3_script_3: Python ----------
from compas.geometry import Point, Sphere, Polyline, Frame, Plane
from compas_rhino.conversions import point_to_compas, vector_to_rhino, frame_to_rhino

sphere = Sphere(936.888)

compas_points = []
for point in points:
    compas_points.append(point_to_compas(point))

projected_points = []
for point in compas_points:
    direction = point - Point(0, 0, 0)
    direction.unitize()
    projected_points.append(Point(0, 0, 0) + direction * sphere.radius)

projected_curve = Polyline(projected_points)

normal_vectors = []
for point in projected_points:
    normal = point - Point(0, 0, 0)
    normal.unitize()
    normal_vectors.append(normal)

frames = []
rhino_planes = []
for point, normal in zip(projected_points, normal_vectors):
    plane = Plane(point, normal)
    frame = Frame.from_plane(plane)

    frames.append(frame)
    rhino_planes.append(frame_to_rhino(frame))
# ---------- end python_3_script_3 ----------
polyline_2 = PolyLine(Vertices=divide_curve_2.Points, Closed=False)
# toolpath_1
point_list_3 = PointList(Points=divide_curve_2.Points, Size="100")
compas_draw_4 = COMPASDraw(cg=python_3_script_3.projected_curve)  # -> rg; same code as compas_draw
compas_draw_5 = COMPASDraw(cg=python_3_script_3.projected_points)  # -> rg; same code as compas_draw
compas_draw_6 = COMPASDraw(cg=python_3_script_3.frames)  # -> rg; same code as compas_draw
point_list_4 = PointList(Points=compas_draw_5, Size="50")
save_2 = Button()
python_3_script_4 = Python3Script(frames=python_3_script_3.frames, save=save_2)  # inputs frames: list
# ---------- python_3_script_4: Python ----------
from compas.data import json_dump
import os

numbered_frames = []
for index, frame in enumerate(frames, start=0):
    numbered_frames.append({"number": index, "frame": frame})

data = {}
data["name"] = "toolpath_1"
data["coordinate_system"] = "wobj0"
data["units"] = "mm"
data["frames"] = numbered_frames

#get current file path
path = ghenv.Component.OnPingDocument().FilePath
#get parent directory of the parent directory
parentdir = os.path.dirname(path)
#get src folder which contains classes
dire = os.path.join(parentdir,'data')


filepath = os.path.join(dire, "toolpath_1.json")

if save:
    json_dump(data, filepath)
# ---------- end python_3_script_4 ----------

divide_curve_3 = DivideCurve(Curve=toolpath_2, Count="20", Kinks=False)  # -> Points, Tangents, Parameters
python_3_script_5 = Python3Script(points=divide_curve_3.Points)  # -> out, projected_curve, projected_points, frames, rhino_planes; inputs points: list of Point3d; same code as python_3_script_3
polyline_3 = PolyLine(Vertices=divide_curve_3.Points, Closed=False)
# toolpath_2
point_list_5 = PointList(Points=divide_curve_3.Points, Size="100")
compas_draw_7 = COMPASDraw(cg=python_3_script_5.projected_curve)  # -> rg; same code as compas_draw
compas_draw_8 = COMPASDraw(cg=python_3_script_5.projected_points)  # -> rg; same code as compas_draw
compas_draw_9 = COMPASDraw(cg=python_3_script_5.frames)  # -> rg; same code as compas_draw
point_list_6 = PointList(Points=compas_draw_8, Size="50")
save_3 = Button()
python_3_script_6 = Python3Script(frames=python_3_script_5.frames, save=save_3)  # inputs frames: list
# ---------- python_3_script_6: Python ----------
from compas.data import json_dump
import os

numbered_frames = []
for index, frame in enumerate(frames, start=0):
    numbered_frames.append({"number": index, "frame": frame})

data = {}
data["name"] = "toolpath_2"
data["coordinate_system"] = "wobj0"
data["units"] = "mm"
data["frames"] = numbered_frames

#get current file path
path = ghenv.Component.OnPingDocument().FilePath
#get parent directory of the parent directory
parentdir = os.path.dirname(path)
#get src folder which contains classes
dire = os.path.join(parentdir,'data')


filepath = os.path.join(dire, "toolpath_2.json")

if save:
    json_dump(data, filepath)
# ---------- end python_3_script_6 ----------

point = Point(Point(-3.352128652, 564.3458026, 705.7386382))
python_3_script_7 = Python3Script(points=point)  # -> out, projected_curve, projected_points, frames, rhino_planes; inputs points: list of Point3d; same code as python_3_script_3
compas_draw_10 = COMPASDraw(cg=python_3_script_7.projected_curve)  # -> rg; same code as compas_draw
compas_draw_11 = COMPASDraw(cg=python_3_script_7.projected_points)  # -> rg; same code as compas_draw
compas_draw_12 = COMPASDraw(cg=python_3_script_7.frames)  # -> rg; same code as compas_draw
panel = Panel(compas_draw_12)
point_list_7 = PointList(Points=compas_draw_11, Size="50")
save_4 = Button()
python_3_script_8 = Python3Script(frames=python_3_script_7.frames, save=save_4)  # inputs frames: list
# ---------- python_3_script_8: Python ----------
from compas.data import json_dump
import os

numbered_frames = []
for index, frame in enumerate(frames, start=0):
    numbered_frames.append({"number": index, "frame": frame})

data = {}
data["name"] = "toolpath_1"
data["coordinate_system"] = "wobj0"
data["units"] = "mm"
data["frames"] = numbered_frames

#get current file path
path = ghenv.Component.OnPingDocument().FilePath
#get parent directory of the parent directory
parentdir = os.path.dirname(path)
#get src folder which contains classes
dire = os.path.join(parentdir,'data')


filepath = os.path.join(dire, "toolpath_home.json")

if save:
    json_dump(data, filepath)
# ---------- end python_3_script_8 ----------
